# Grasshopper definition grasshopper_to_place_cone.gh (Grasshopper 1.0.8)

number_slider = Slider(80, range=0..1000)
pt = Point(Point(0, 0, 0))
number_slider_2 = Slider(150, range=0..5000)
number_slider_3 = Slider(406.4, range=0..1000)
brep = Brep(<brep referenced from the Rhino model>)
pt_2 = Point(Point(2409.247621, 1159.851361, 1369.105749))
vec2pt = Vector2Pt(PointA=pt, PointB=pt_2, Unitize=False)  # -> Vector, Length
series = Series(Start=0, Step=Slider(200, range=0..1000), Count=Slider(5, range=1..50))
pt_3 = ConstructPoint(XCoordinate=number_slider, YCoordinate=number_slider_2, ZCoordinate=0)
subtraction = Subtraction(A=number_slider_3, B=number_slider)
addition = Addition(A=number_slider_2, B=Slider(157, range=-1000..1000))
rectangle = Rectangle(Plane=PlaneXY(0, 0, 0), XSize=number_slider_3, YSize=Slider(2679.7, range=0..5000), Radius=0)  # -> Rectangle, Length
move = Move(Geometry=rectangle.Rectangle, Motion=vec2pt.Vector)  # -> Geometry, Transform
pt_4 = ConstructPoint(XCoordinate=subtraction, YCoordinate=addition, ZCoordinate=0)
Y = UnitY(Factor=series)
merge = Merge(Data1=pt_3, Data2=pt_4)
move_2 = Move(Geometry=graft(merge), Motion=Y)  # -> Geometry, Transform
move_3 = Move(Geometry=move_2.Geometry, Motion=vec2pt.Vector)  # -> Geometry, Transform
move_4 = Move(Geometry=brep, Motion=move_3.Geometry)  # -> Geometry, Transform
lng = ListLength(List=flatten(move_4.Geometry))
panel = Panel(lng)
